# Dynamo graph Delete_Unused_Filter.dyn (Dynamo 2.19.3.6394)
# packages: Clockwork for Dynamo 3.x 3.3.0, Data-Shapes 2025.3.119

string = StringInput("Please note: Deletions cannot be undone")
string_2 = StringInput("Delete Selected")
string_3 = StringInput("Select the filters to be excluded")
python_script = Python()  # CPython3; unwired: IN[0]
# ---------- python_script.python (14 lines) ----------
import clr
clr.AddReference('RevitAPI')
from Autodesk.Revit.DB import *

clr.AddReference('RevitServices')
import RevitServices
from RevitServices.Persistence import DocumentManager

doc = DocumentManager.Instance.CurrentDBDocument

collector = FilteredElementCollector(doc).OfClass(ParameterFilterElement)
filters = collector.ToElements()

OUT = filters
# ----------------------------------------
categories = Categories("OST_Views")
all_elements_of_category = ElementsOfCategory(Category=categories)
boolean = BoolSelector(true)
isViewTemplate = View.IsViewTemplate(view=boolean)
filterByBoolMask = List.FilterByBoolMask(list=all_elements_of_category, mask=isViewTemplate)
python_script_2 = Python(IN[0]=filterByBoolMask.in)  # CPython3
# ---------- python_script_2.python (25 lines) ----------
import clr
clr.AddReference('RevitAPI')
from Autodesk.Revit.DB import *

clr.AddReference('RevitServices')
import RevitServices
from RevitServices.Persistence import DocumentManager

doc = DocumentManager.Instance.CurrentDBDocument
view_templates = IN[0]

applied_filters = []

for view in view_templates:
    # Desembrulha o elemento do Dynamo para o elemento da API do Revit
    view = UnwrapElement(view)
    
    # Obtém os IDs dos filtros aplicados na vista
    filter_ids = view.GetFilters()
    
    if filter_ids:
        for filter_id in filter_ids:
            applied_filters.append(doc.GetElement(filter_id))

OUT = applied_filters
# ----------------------------------------
uniqueItems = List.UniqueItems(list=python_script_2)
setDifference = List.SetDifference(list1=python_script, list2=uniqueItems)
name = Custom[Element.Name+](element=setDifference)  # package Clockwork for Dynamo 3.x; Gets an element's name. Unlike the OOTB node, this node should work for *all* Revit elements that have names and will also return the localized names of system parameters, parameter groups, display unit types, parameter types, unit symbol types, unit types and ForgeTypeIds.
listview_data = Custom[Listview Data](InputName=string_3, Keys=name, Values=setDifference)  # package Data-Shapes; Create data for ListView input in UI.MultiInputForm ++ . Check out www.data-shapes.net for more infos.
boolean_2 = BoolSelector(true)
multipleinputform = Custom[MultipleInputForm ++](Description_optional=string, ButtonText_optional=string_2, Inputs=listview_data, Toggle=boolean_2)  # package Data-Shapes; Create a form with multiple inputs. see www.data-shapes.net for tutorials and infos!
firstItem = List.FirstItem(list=multipleinputform.User_Inputs)
delete = Element.Delete(element=firstItem)
